# Grasshopper definition 01_grasshopper_robots_sample.gh (Grasshopper 1.0.7)
# plug-ins: Robots, treesloth01

# ---- group: Robot
list = ValueList({"AAU_Utzon-UR10", "AAU_Utzon-UR10_at_Height"}, selected="AAU_Utzon-UR10")
load_robot = LoadRobotSystem(Name=list, Base=PlaneXY(0, 0, 0))

# ---- group: Create a set of Planes
crv = Curve(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)
number_slider = Slider(0.529, range=0..1)
divide = DivideCurve(Curve=crv, Count=15, Kinks=False)  # -> Points, Tangents, Parameters
xy = XYPlane(Origin=divide.Points)
pflip = FlipPlane(Plane=xy, ReverseX=False, ReverseY=False, SwapAxes=True)
first_last = FirstLast(List=pflip)  # -> FirstValue, LastValue
pl_offset = PlaneOffset(BasePlane=first_last.FirstValue, Offset="-150")
pl_offset_2 = PlaneOffset(BasePlane=first_last.LastValue, Offset="-150")
merge = Merge(Data1=pl_offset, Data2=pflip, Data3=pl_offset_2)

# ---- group: Create Program
target = CreateTarget(Plane=merge, IsCartesian=True)
program = CreateProgram(Name="DefaultProgram", RobotSystem=load_robot, Targets1=target, StepSize=1)  # -> Program, Code, Duration, Warnings, Errors
sim = ProgramSimulation(Program=program.Program, Time=number_slider, Normalized=True)  # -> SystemMeshes, JointRotations, Plane, Index, Time, Program, Errors

# ---- group: Preview
preview = CustomPreview(Geometry=sim.SystemMeshes, Material=ColourSwatch(SwatchColor=RGB(212, 212, 212)))

# ---- group: Upload Program
send_program = Button()
play = Button()
stop = Button()
ursim_ip = Panel("192.168.56.103")
remote = RemoteConnection(Program=program.Program, IP=ursim_ip, Upload=send_program, Play=play, Pause=stop)
